# Grasshopper definition RayTracing_01.gh (Grasshopper 0.9.76)
# plug-ins: Python Interpreter

number_slider = Slider(6, range=0..100)
pt = ConstructPoint(XCoordinate=number_slider, YCoordinate=number_slider, ZCoordinate=number_slider)
geo = Geometry(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)
python = PythonScript(G=geo, n=Slider(1, range=1..1000), SP=pt, R=Slider(11, range=1..1000))  # -> Rays, ReflectPoints; inputs G: Brep, n: Int32, SP: Point3d, R: Int32
# ---------- python: Python ----------
import random
import math
import rhinoscriptsyntax as rs
import Rhino as rc
    
Geo=rc.Geometry.Brep.Duplicate(G)
Origo=rs.AddPoint(0,0,0)
    
#Testing wether source point is contained within Geometry
CS = Geo.IsPointInside(SP,0.01,True)

#Number of Surfaces in Geometry
F=Geo.Surfaces.Count

#Extracting Surfaces from Geometry
Surfaces=[]
def Surf(f):
    surface=rs.ExtractSurface(G,f,copy=True)
    return surface[0]
print range (int(F))
for f in range (F):
    Surfaces.append(Surf(f))

#Extracting Surface Points from Geometry Surfaces
SurfPoints=[]
def SurfacePoints(f):
    point=rs.SurfaceAreaCentroid(Surfaces[f])
    return point[0]
print range (int(F))
for f in range (F):
    SurfPoints.append(SurfacePoints(f))

#Surface Normal Vectors
Param=[]
def UV_Param(f):
    point=rs.SurfaceClosestPoint(Surfaces[f],SurfPoints[f])
    return point[0]
print range (int(F))
for f in range (F):
    Param.append(UV_Param(f))
    
SurfNormal=[]
def SurfaceNormal(f):
    vector=rs.VectorReverse(rs.SurfaceNormal(Surfaces[f],Param))
    return vector
print range (int(F))
for f in range (F):
    SurfNormal.append(SurfaceNormal(f))
    

#Ray Vector Points
def RayPoints(theta,phi):
    point=rs.AddPoint(math.sin(theta)*math.cos(phi), math.sin(theta)*math.sin(phi), math.cos(theta))
    return point
#Ray Vectors between Ray Vector Points and Origo
def RayVectors(RayPoints,OrigoPoints):
    Vector=rs.VectorCreate(RayPoints,Origo)
    return Vector
    
#RayVectors
RayVec=[]
print range(int(n))
for i in range (n):
    theta = random.uniform(0,(2*math.pi))  
    phi = random.uniform(0,(2*math.pi))
    RayVec.append(RayVectors(RayPoints(theta,phi),Origo))


ReflectionPoints=[SP]
Rays=[]
RayData=[]
RayData.append(SP)
RayData.append(RayVec[0])

r = R
while r > 0:

    #Vector From Source to Geometry planes
    LenVec=[]
    def LengthVectors(f):
        vector=rs.VectorCreate(SurfPoints[f],RayData[0])
        return vector
    print range (int(F))
    for f in range (F):
        LenVec.append(LengthVectors(f))

    #Distance from Source Point to Geometry Surfaces
    Dist=[]
    def Distance(f):
        length=rs.VectorDotProduct(SurfNormal[f],LenVec[f])/rs.VectorDotProduct(RayData[1],SurfNormal[f])
        return length
    print range (int(F))
    for f in range (F):
        Dist.append(Distance(f))
    
    #Minimum distance
    DistMin=min([n for n in Dist  if n>0])
    index=[i for i,x in enumerate(Dist) if x == DistMin]

    #Reflection Point
    ReflectionPoint=RayData[0]+RayData[1]*DistMin
    
    ReflectionPoints.append(ReflectionPoint)
    ReflectPoints=ReflectionPoints[:-1]
    
    Rays.append(rs.VectorCreate(ReflectionPoint,RayData[0]))

    #Reflected Vector
    ReflectionVec=RayData[1]-2*(rs.VectorDotProduct(SurfNormal[index[0]],RayData[1]))*SurfNormal[index[0]]
    
    RayData=(ReflectionPoint,ReflectionVec)
    
    r = r-1
# ---------- end python ----------
vdis = VectorDisplay(Anchor=python.ReflectPoints, Vector=python.Rays)
